# Grasshopper definition tambour.gh (Grasshopper 1.0.8)
# Copyright: GNU Lesser General Public License Version 3
# plug-ins: RhinoCodePluginGH, semio

number_slider = Slider(0, range=0..3)
panel = Panel("""First Storey
Last Storey
Single Storey""")
save_representation = BooleanToggle(False)
icon_export = BooleanToggle(False)
validate = BooleanToggle(False)
save = BooleanToggle(False)
sep = Separator()  # -> S
# ---------- sep: C# ----------
#region Usings
using System;
using System.Linq;
using System.Collections;
using System.Collections.Generic;
using System.Drawing;
using System.IO;

using Rhino;
using Rhino.Geometry;

using Grasshopper;
using Grasshopper.Kernel;
using Grasshopper.Kernel.Data;
using Grasshopper.Kernel.Types;
#endregion

public class Script_Instance : GH_ScriptInstance
{
    private void RunScript(ref object S)
    {
        S = Path.DirectorySeparatorChar;
    }
}
# ---------- end sep ----------
dir = Directory()  # -> D
# ---------- dir: C# ----------
#region Usings
using System;
using System.Linq;
using System.Collections;
using System.Collections.Generic;
using System.Drawing;
using System.IO;

using Rhino;
using Rhino.Geometry;

using Grasshopper;
using Grasshopper.Kernel;
using Grasshopper.Kernel.Data;
using Grasshopper.Kernel.Types;
#endregion

public class Script_Instance : GH_ScriptInstance
{
    private void RunScript(ref object D)
    {
        D = Path.GetDirectoryName(this.GrasshopperDocument.FilePath);
    }
}
# ---------- end dir ----------
loop_slider = PythonScript(
    SliderToModify=number_slider,
    Min="0",
    Max="3",
    stepSize="1",
    Delay=Slider(0, range=0..1),
    Run=Toggle(False),
    Reset=Button())  # inputs Run: Boolean, Reset: Boolean
# ---------- loop_slider: Python ----------
import time

def updateSliderInput(inputName,min,max,value,decimalPlace=2):
    for input in ghenv.Component.Params.Input:
        for source in input.Sources:
            if input.Name == str(inputName):
                source.Slider.DecimalPlaces = decimalPlace
                source.Slider.Minimum = min
                source.Slider.Maximum = max
                source.Slider.Value = value
                source.ExpireSolution(True)

def countDecimal(number):
    string= str(number)
    return string[::-1].find('.')

if Run == True:
    if SliderToModify < Max:
        time.sleep(Delay)
        updateSliderInput("SliderToModify",Min,Max,SliderToModify+stepSize,countDecimal(stepSize))
if Reset == True:
    updateSliderInput("SliderToModify",Min,Max,Min)
# ---------- end loop_slider ----------
# ^                                    ^
#    |                                     |
# <-- Constants    Preview -->
# Parameters    External    Local -->
# <-- Meta               |
#      |                       v
#      v
par = ParentDirectory(D=dir)  # -> P; inputs D: String
# ---------- par: C# ----------
#region Usings
using System;
using System.Linq;
using System.Collections;
using System.Collections.Generic;
using System.Drawing;
using System.IO;

using Rhino;
using Rhino.Geometry;

using Grasshopper;
using Grasshopper.Kernel;
using Grasshopper.Kernel.Data;
using Grasshopper.Kernel.Types;
#endregion

public class Script_Instance : GH_ScriptInstance
{
    private void RunScript(string D, ref object P)
    {
        P = new DirectoryInfo(D).Parent;
    }
}
# ---------- end par ----------
item = ListItem(List=panel, Index=number_slider, Wrap=True)
panel_2 = Panel(item)
and = GateAnd(A=save, B=save_representation)
and_2 = GateAnd(A=save, B=icon_export)
variant = GetString(item, AtLeast=0, AtMost=1, TreeAccess=False)
itemindex = ItemIndex(L=panel, I=variant)  # -> i; inputs L: list
# ---------- itemindex: Python ----------
#Component Information
#--------------------------------------------------------------------------------------------
if ghenv.Component.RunCount<2:
    #General
    #--------------------------------------------------------------------------------------------
    __author__ = "Ueli Saluz"
    __version__ = "2022.11.18"
    
    ghenv.Component.Name = "ItemIndex"
    ghenv.Component.NickName = "ItemIndex"
    ghenv.Component.Description = "A better IdemIndex"
    ghenv.Component.Message = "VER 1.0"
    ghenv.Component.Category = "Set"
    ghenv.Component.SubCategory = "List"
    
     #Inputs
    #--------------------------------------------------------------------------------------------
    inputIndex=0
    
    ghenv.Component.Params.Input[inputIndex].Name = "List"
    ghenv.Component.Params.Input[inputIndex].NickName = "L"
    ghenv.Component.Params.Input[inputIndex].Description = "Input1 is..."
    ghenv.Component.Params.Input[inputIndex].Optional = False
    inputIndex+=1
    
    ghenv.Component.Params.Input[inputIndex].Name = "Item"
    ghenv.Component.Params.Input[inputIndex].NickName = "I"
    ghenv.Component.Params.Input[inputIndex].Description = "Input2 is..."
    ghenv.Component.Params.Input[inputIndex].Optional = False
    inputIndex+=1
    
    #Outputs
    #--------------------------------------------------------------------------------------------
    outputIndex=0
    
    ghenv.Component.Params.Output[outputIndex].Name = "Index"
    ghenv.Component.Params.Output[outputIndex].NickName = "i"
    ghenv.Component.Params.Output[outputIndex].Description = "Output1 is..."
    outputIndex+=1

i = L.index(I)
# ---------- end itemindex ----------
panel_3 = Panel("""_first-storey
_last-storey
_single-storey""")
panel_4 = Panel("""F
T
F
T""")
panel_5 = Panel("""F
F
T
T""")
zoom = Button()
item_2 = ListItem(List=panel_4, Index=itemindex, Wrap=True)
item_3 = ListItem(List=panel_5, Index=itemindex, Wrap=True)
item_4 = ListItem(List=panel, Index=itemindex, Wrap=True)
expression = Expression(x=Slider(550, range=0..1000), Expression="x/100")
expression_2 = Expression(x=Slider(275, range=0..1000), Expression="x/100")
list = ValueList({"North": "north", "East": "east", "South": "south", "West": "west"}, selected="North")
expression_3 = Expression(x=Slider(20, range=0..100), Expression="x/100")
slab_thickness_m = Number(expression_3)
floors = Integer(Slider(1, range=0..20))

series = Series(Start="1", Step=1, Count="2")
dup = DuplicateData(Data="0", Number="4", Order=True)
trim = TrimTree(Tree=series, Depth=1)  # -> graft(Tree)
trim_2 = TrimTree(Tree=dup, Depth=1)
dup_2 = DuplicateData(Data=trim, Number="2", Order=True)  # -> flatten(Data)
merge = Merge(Data1=trim_2, Data2=dup_2)
dup_3 = DuplicateData(Data=merge, Number=floors, Order=True)
trim_3 = TrimTree(Tree=dup_3, Depth=1)
loc = ModelLocator(Group="split level", Subgroup=trim_3)  # -> Locator, Valid, Group, Subgroup
concat = Concatenate(FragmentA="sl", FragmentC=trim_3)

equals = Equality(FirstNumber=trim_3, SecondNumber="0")  # -> Equality, Inequality
panel_6 = Panel("""main
side""")
item_5 = ListItem(List=panel_6, Index=equals.Equality, Wrap=True)
loc_2 = ModelLocator(Validate=validate, Group="platform", Subgroup=item_5)  # -> Locator, Valid, Group, Subgroup

width_m = Number(expression)
floor_height_m = Number(expression_2)
include_top = Boolean(item_3)
int = Integer(include_top)
platform = Text(list)
include_bottom = Boolean(item_2)
int_2 = Integer(include_bottom)
concat_2 = Concatenate(FragmentA=int, FragmentB=int_2)
b2d = BinaryToDecimal(Binary=concat_2)  # -> Decimal
# ---------- b2d: Python ----------
if ghenv.Component.RunCount<2:
    __author__ = "Ueli Saluz"
    __version__ = "2021.11.14"
    
    ghenv.Component.Name = "BinaryToDecimal"
    ghenv.Component.NickName = "B2D"
    ghenv.Component.Description = "Converts a number in binary representation to a number in decimal representation."
    ghenv.Component.Message = "VER 1.0"
    
    ghenv.Component.Params.Input[0].NickName = "Binary"
    
    ghenv.Component.Params.Input[0].Description = "Binary representation of a number."
    
    ghenv.Component.Params.Output[0].NickName = "Decimal"
    
    ghenv.Component.Params.Output[0].Description = "Converted decimal representation of the same number."

if __name__ == "__main__":
    Decimal = int(Binary,2)
# ---------- end b2d ----------

panel_7 = Panel("""f9222724e5
b27c179b7d
89d6e55762
c5850e2821
53dc156694
345fa2173d
73566dc911
8965b08c83""")
dup_4 = DuplicateData(Data="2", Number="4", Order=True)
concat_3 = Concatenate(FragmentA="https://app.speckle.systems/projects/e7de1a2f8f/models/", FragmentB=panel_7)
trim_4 = TrimTree(Tree=dup_4, Depth=1)
partition = PartitionList(List=concat_3, Size=trim_4)
tstat = TreeStatistics(Tree=partition)  # -> Paths, Length, Count
item_6 = ListItem(List=flatten(tstat.Paths), Index=b2d, Wrap=True)
branch = TreeBranch(Tree=partition, Path=item_6, MaintainPaths=True)
item_7 = ListItem(List=flatten(branch), Index=0, Wrap=True)  # -> Item, Item1

item_8 = ListItem(List=panel_3, Index=b2d, Wrap=True)

mime = ValueList({".stl": "model/stl", ".obj": "model/obj", ".glb": "model/gltf-binary", ".gltf": "model/gltf+json", ".3dm": "model/vnd.3dm", ".speckle": "model/vnd.speckle+json", ".png": "image/png", ".jpg": "image/jpeg", ".jpeg": "image/jpeg", ".svg": "image/svg+xml", ".pdf": "application/pdf", ".zip": "application/zip", ".json": "application/json", ".csv": "text/csv", ".txt": "text/plain"}, selected=".speckle")
concat_4 = Concatenate(FragmentA="tambour", FragmentB=item_8)
concat_5 = Concatenate(FragmentA=concat_4, FragmentB="_", FragmentE="1to500", FragmentG="_", FragmentF="volume")
concat_6 = Concatenate(FragmentA=concat_4, FragmentB="_", FragmentE="1to200", FragmentG="_", FragmentF="volume")
concat_7 = Concatenate(FragmentC="representations", FragmentD=sep, FragmentA=concat_4)
concat_8 = Concatenate(FragmentC="representations", FragmentD=sep, FragmentA=concat_5)
concat_9 = Concatenate(FragmentC="representations", FragmentD=sep, FragmentA=concat_6)
concat_10 = Concatenate(FragmentA=concat_7, FragmentB=".glb")
concat_11 = Concatenate(FragmentA=concat_8, FragmentB=".3dm")
concat_12 = Concatenate(FragmentA=concat_9, FragmentB=".3dm")
rep = ModelRepresentation(Validate=validate, Url=concat_10)  # -> Representation, Valid, Url, Mime, Lod, Tags
rep_2 = ModelRepresentation(Validate=validate, Url=concat_12, Lod="1to200", Tags="volume")  # -> Representation, Valid, Url, Mime, Lod, Tags
rep_3 = ModelRepresentation(Validate=validate, Url=concat_11, Lod="1to500", Tags="volume")  # -> Representation, Valid, Url, Mime, Lod, Tags
trim_5 = TrimTree(Tree=rep_3.Tags, Depth=1)
trim_6 = TrimTree(Tree=rep_2.Tags, Depth=1)
rep_4 = ModelRepresentation(Validate=validate, Url=item_7.Item1, Mime=mime, Lod=rep_2.Lod, Tags=trim_6)  # -> Representation, Valid, Url, Mime, Lod, Tags
rep_5 = ModelRepresentation(Validate=validate, Url=item_7.Item, Mime=mime, Lod=rep_3.Lod, Tags=trim_5)  # -> Representation, Valid, Url, Mime, Lod, Tags
merge_2 = Merge(
    Data1=rep.Representation,
    Data2=rep_3.Representation,
    Data3=rep_5.Representation,
    Data4=rep_2.Representation,
    Data5=rep_4.Representation)

panel_8 = Panel("An efficient one storey tambour for a rectangular shaft core with an elevator in the center, the main platform on the ")
panel_9 = Panel(""", and on the other corners sides platforms with two doors. There is a stair between 
every platform. Hence the doors are spiraling around.""")
concat_13 = Concatenate(FragmentA=panel_8, FragmentB=platform, FragmentC=panel_9)

concat_14 = Concatenate(FragmentA="icons/", FragmentB=concat_4, FragmentC=".svg")
concat_15 = Concatenate(FragmentA="images/", FragmentB=concat_4, FragmentC=".svg")
expression_4 = Expression(x=Slider(30, range=0..100), Expression="x/100")
expression_5 = Expression(x=Slider(80, range=0..200), Expression="x/100")
expression_6 = Expression(x=Slider(200, range=0..1000), Expression="x/100")
expression_7 = Expression(x=Slider(115, range=0..1000), Expression="x/100")
wall_thickness_m = Number(expression_4)
door_width_m = Number(expression_5)
door_height_m = Number(expression_6)
door_offset_m = Number(expression_7)
maintenance_expenses_month_eff_m² = Slider(3.5, range=0..10)
construction_area_factor = Slider(0.2, range=0..1)
construction_cost_eff_m² = Slider(9000, range=0..10000)
panel_10 = Panel("Parallel")  # disabled
m2d_rhino = Make2DRhinoView(Name=panel_10, Clip=True)  # disabled
number_slider_2 = Slider(876, range=0..1000)  # disabled
view_rectangle = ViewRectangle(view=m2d_rhino)  # disabled
maintenance_expenses_month_eff_m²_2 = Number(maintenance_expenses_month_eff_m²)
construction_area_factor_2 = Number(construction_area_factor)
construction_cost_eff_m²_2 = Number(construction_cost_eff_m²)
previewplane = PreviewPlane(plane=view_rectangle, axis_length=number_slider_2)  # disabled
cooling_energy_demand_kwh_m²a = Number(Slider(10, range=0..200))
heating_energy_demand_kwh_m²a = Number(Slider(20, range=0..200))
technical_equipment_energy_demand_kwh_m² = Number(Slider(20, range=0..200))  # "Technical Equipment Energy Demand[kWh/m²a]"
construction_global_warming_potential_kg = Number(Slider(1500, range=0..2000))  # "Construction Global Warming Potential [kgCO2e/eff. m²]"

maintenance_expenses_month_eff_m²_3 = Number(maintenance_expenses_month_eff_m²_2)
# Outputs   ->
#                 |
#                 v
construction_global_warming_potential_kg_2 = Number(construction_global_warming_potential_kg)  # "Construction Global Warming Potential [kgCO2e/eff. m²]"
technical_equipment_energy_demand_kwh_m²_2 = Number(technical_equipment_energy_demand_kwh_m²)  # "Technical Equipment Energy Demand[kWh/m²a]"
construction_area_factor_3 = Number(construction_area_factor_2)
heating_energy_demand_kwh_m²a_2 = Number(heating_energy_demand_kwh_m²a)
cooling_energy_demand_kwh_m²a_2 = Number(cooling_energy_demand_kwh_m²a)
construction_cost_eff_m²_3 = Number(construction_cost_eff_m²_2)
expression_8 = Expression(x=construction_area_factor_3, Expression="1-x")
multiplication = Multiplication(B=construction_global_warming_potential_kg_2)
round = Round(Number=multiplication)  # -> Nearest, Floor, Ceiling
panel_11 = Panel("""width
storeys
floor height
platform
door width
door height
door offset
effective floor area
construction cost
heating energy demand
cooling energy demand
technical equipment energy demand
maintenance expenses
construction global warming potential""")
panel_12 = Panel("""https://identifier.buildingsmart.org/uri/buildingsmart/ifc/4.3/prop/Width 
https://identifier.buildingsmart.org/uri/buildingsmart/ifc/4.3/class/IfcBuildingStorey
https://identifier.buildingsmart.org/uri/buildingsmart/ifc/4.3/prop/GrossHeight




https://identifier.buildingsmart.org/uri/buildingsmart/ifc/4.3/prop/NetFloorArea

https://identifier.buildingsmart.org/uri/buildingsmart/ifc/4.3/prop/EnergyConsumption
https://identifier.buildingsmart.org/uri/buildingsmart/ifc/4.3/prop/EnergyConsumption
https://identifier.buildingsmart.org/uri/buildingsmart/ifc/4.3/prop/EnergyConsumption

https://identifier.buildingsmart.org/uri/etim/etim/9.0/prop/EF016979""")
panel_13 = Panel("""m

m

m
m
m
m²
€
kWh/a
kWh/a
kWh/a
€/a
kgCO2e""")

series_2 = Series(Start=0, Step=1, Count="4")
series_3 = Series(Start=0, Step=1, Count="2")
trim_7 = TrimTree(Tree=series_2, Depth=1)
trim_8 = TrimTree(Tree=series_3, Depth=1)
merge_3 = Merge(Data1=trim_7, Data2=trim_8, Data3=trim_8)

panel_14 = Panel("""west
south
south
east
east
north
north
west""")

expression_9 = Expression(x=floors, Expression="x+1")
int_3 = Integer(expression_9)
expression_10 = Expression(x=int_3, Expression="(x-1)*4")

panel_15 = Panel("""north
east
south
west""")
itemindex_2 = ItemIndex(L=panel_15, I=platform)  # -> i; inputs L: list; same code as itemindex
valueor0 = ValueOr0(value=itemindex_2)
expression_11 = Expression(x=valueor0, Expression="-((x+2)*90)%360")
_2d = _2D(x=width_m)
rectangle = Rectangle(Plane=PlaneXY(0, 0, 0), XSize=_2d, YSize=_2d, Radius=0)  # -> Rectangle, Length
expression_12 = Expression(x=width_m, Expression="x/2")
expression_13 = Expression(x=door_width_m, Expression="x/2")
subtraction = Subtraction(A=expression_12, B=expression_13, C=door_offset_m, D=wall_thickness_m)

area = Area(Geometry=rectangle.Rectangle)  # -> Area, Centroid
multiplication_2 = Multiplication(A=area.Area, B=floors)
multiplication_3 = Multiplication(A=multiplication_2, B=expression_8)
multiplication_4 = Multiplication(A=multiplication_3, B=maintenance_expenses_month_eff_m²_3)
expression_14 = Expression(x=multiplication_4, Expression="x*12")
multiplication_5 = Multiplication(A=heating_energy_demand_kwh_m²a_2, B=multiplication_3)
multiplication_6 = Multiplication(A=cooling_energy_demand_kwh_m²a_2, B=multiplication_3)
multiplication_7 = Multiplication(A=multiplication_3, B=construction_cost_eff_m²_3)
multiplication_8 = Multiplication(A=technical_equipment_energy_demand_kwh_m²_2, B=multiplication_3)
roundmult = RoundToMultiple(N=multiplication_3, M="0.01")  # -> R; inputs N: tree, M: tree
# ---------- roundmult: Python ----------
#Component Information
#--------------------------------------------------------------------------------------------
if ghenv.Component.RunCount<2:
    #General
    #--------------------------------------------------------------------------------------------
    __author__ = "YOUR NAME"
    __version__ = "2000.00.00"
    
    ghenv.Component.Name = "Round to Multiple"
    ghenv.Component.NickName = "RoundMult"
    ghenv.Component.Description = "Rounds a number to the nearest specified multiple."
    ghenv.Component.Message = "VER 1.0"
    ghenv.Component.Category = "Math"
    ghenv.Component.SubCategory = "Arithmetic"
    
     #Inputs
    #--------------------------------------------------------------------------------------------
    inputIndex=0
    
    ghenv.Component.Params.Input[inputIndex].Name = "Number"
    ghenv.Component.Params.Input[inputIndex].NickName = "N"
    ghenv.Component.Params.Input[inputIndex].Description = "Number to round."
    ghenv.Component.Params.Input[inputIndex].Optional = False
    inputIndex+=1
    
    ghenv.Component.Params.Input[inputIndex].Name = "Multiple"
    ghenv.Component.Params.Input[inputIndex].NickName = "M"
    ghenv.Component.Params.Input[inputIndex].Description = "Multiple to round to."
    ghenv.Component.Params.Input[inputIndex].Optional = False
    inputIndex+=1
    
    #Outputs
    #--------------------------------------------------------------------------------------------
    outputIndex=0
    
    ghenv.Component.Params.Output[outputIndex].Name = "Rounded"
    ghenv.Component.Params.Output[outputIndex].NickName = "R"
    ghenv.Component.Params.Output[outputIndex].Description = "Number rounded to the nearest specified multiple."
    outputIndex+=1


#Imports
#--------------------------------------------------------------------------------------------
from System import Object
from Grasshopper import DataTree
import math


#The Component function - Business logic only (e.g. working without trees)
#--------------------------------------------------------------------------------------------
"""Function that this component is computing.
    Inputs:
        number: The number to round.
        multiple: The multiple to round to.
    Output:
        rounded: The number rounded to the nearest specified multiple."""
def RoundToMultiple(number, multiple):
    rounded = math.ceil(number / multiple) * multiple
    return rounded

#Solver - Run with trees to enhance performance drastically
#--------------------------------------------------------------------------------------------
if __name__ == "__main__":
    
    #Initialize trees
    #--------------------------------------------------------------------------------------------
    RoundedTree = DataTree[Object]()
    
    #Data matching
    #--------------------------------------------------------------------------------------------
    for path in N.Paths:
        numberBranch = N.Branch(path)
        for i, number in enumerate(numberBranch):
            multiple = M.Branch(path)[i]
            rounded = RoundToMultiple(number, multiple)
            RoundedTree.Add(rounded, path)
    
     #Assign trees to output
    #--------------------------------------------------------------------------------------------
    R = RoundedTree
# ---------- end roundmult ----------
round_2 = Round(Number=multiplication_7)  # -> Nearest, Floor, Ceiling
round_3 = Round(Number=multiplication_5)  # -> Nearest, Floor, Ceiling
round_4 = Round(Number=multiplication_6)  # -> Nearest, Floor, Ceiling
round_5 = Round(Number=multiplication_8)  # -> Nearest, Floor, Ceiling
round_6 = Round(Number=expression_14)  # -> Nearest, Floor, Ceiling
merge_4 = Merge(
    Data1=width_m,
    Data2=floors,
    Data3=floor_height_m,
    Data4=platform,
    Data5=door_width_m,
    Data6=door_height_m,
    Data7=door_offset_m,
    Data8=roundmult,
    Data9=round_2.Nearest,
    Data10=round_3.Nearest,
    Data11=round_4.Nearest,
    Data12=round_5.Nearest,
    Data13=round_6.Nearest,
    Data14=round.Nearest)
panel_16 = Panel(merge_4)
qal = ModelQuality(Validate=validate, Name=panel_11, Value=panel_16, Unit=panel_13, Definition=panel_12)  # -> Quality, Valid, Name, Value, Unit, Definition

expression_15 = Expression(x=valueor0, Expression="(-x)*2")
shift = ShiftList(List=panel_14, Shift=expression_15, Wrap=True)

expression_16 = Expression(x=floor_height_m, Expression="x*(2/3)")
_2d_2 = _2D(x=width_m)
expression_17 = Expression(x=width_m, Expression="x/2")
neg = Negative(Value=expression_17)
nand = GateNand(A=include_bottom, B=include_top)

addition = Addition(A=floor_height_m, B=expression_16)
coreheight = Number(addition)
dom = ConstructDomain(DomainStart=0, DomainEnd=coreheight)
box = DomainBox(Base=PlaneXY(0, 0, 0), X=_2d, Y=_2d, Z=dom)
corevolume = Box(box)
debrep = DeconstructBrep(Brep=corevolume)  # -> Faces, Edges, Vertices
trim_9 = TrimTree(Tree=debrep.Faces, Depth=1)
item_9 = ListItem(List=trim_9, Index=0, Wrap=True)  # -> Item, Item1, Item2, Item3, Item4
base = Surface(item_9.Item4)
explode = Explode(Curve=base, Recursive=True)  # -> Segments, Vertices
trim_10 = TrimTree(Tree=explode.Segments, Depth=1)
join = JoinCurves(Curves=explode.Segments, Preserve=False)
trim_11 = TrimTree(Tree=join, Depth=1)
curvepoint = PointOnCurve(trim_10, parameter=0.5)
crv_cp = CurveClosestPoint(Point=curvepoint, Curve=trim_10)  # -> Point, Parameter, Distance
addition_2 = Addition(A=crv_cp.Parameter, B=subtraction)
subtraction_2 = Subtraction(A=crv_cp.Parameter, B=subtraction)
eval = EvaluateCurve(Curve=trim_10, Parameter=addition_2)  # -> Point, Tangent, Angle
eval_2 = EvaluateCurve(Curve=trim_10, Parameter=subtraction_2)  # -> Point, Tangent, Angle
shift_2 = ShiftList(List=eval_2.Point, Shift=1, Wrap=True)
trim_12 = TrimTree(Tree=shift_2, Depth=1)
merge_5 = Merge(Data1=graft(eval.Point), Data2=graft(trim_12))

expression_18 = Expression(x=floor_height_m, Expression="x/3")
lng = ListLength(List=trim_10)
dup_5 = DuplicateData(Data=expression_18, Number=lng, Order=True)
trim_13 = TrimTree(Tree=dup_5, Depth=1)
replace = ReplaceItems(List=trim_13, Item="0", Indices="1", Wrap=False)
repeat = RepeatData(Data=replace, Length=expression_10)
trim_14 = TrimTree(Tree=repeat, Depth=1)
ma = MassAddition(Input=trim_14)  # -> Result, PartialResults
flip = FlipMatrix(Data=ma.PartialResults)
doorheights = Number(flip)
Z = UnitZ(Factor=doorheights)
trim_15 = TrimTree(Tree=Z, Depth=1)
cset = CreateSet(List=trim_15)  # -> Set, graft(Map)
path = ConstructPath(Indices=cset.Map)
trim_16 = TrimTree(Tree=path, Depth=1)

l2o = List2Object(L=merge_5)  # -> O; inputs L: tree
# ---------- l2o: Python ----------
#Component Information
#--------------------------------------------------------------------------------------------
if ghenv.Component.RunCount<2:
    #General
    #--------------------------------------------------------------------------------------------
    __author__ = "Ueli Saluz"
    __version__ = "2022.04.24"
    
    ghenv.Component.Name = "List2Object"
    ghenv.Component.NickName = "L2O"
    ghenv.Component.Description = "Wraps a list of objects into a list object."
    ghenv.Component.Message = "VER 1.0"
    ghenv.Component.Category = "Sets"
    ghenv.Component.SubCategory = "Tree"
    
     #Inputs
    #--------------------------------------------------------------------------------------------
    inputIndex=0
    
    ghenv.Component.Params.Input[inputIndex].Name = "List"
    ghenv.Component.Params.Input[inputIndex].NickName = "L"
    ghenv.Component.Params.Input[inputIndex].Description = "Tree with lists to wrap."
    ghenv.Component.Params.Input[inputIndex].Optional = False
    inputIndex+=1
    

    #Outputs
    #--------------------------------------------------------------------------------------------
    outputIndex=0
    
    ghenv.Component.Params.Output[outputIndex].Name =  "ListObject" 
    ghenv.Component.Params.Output[outputIndex].NickName = "O"
    ghenv.Component.Params.Output[outputIndex].Description = "Python list object as single item."
    outputIndex+=1


#Imports
#--------------------------------------------------------------------------------------------
from System import Object
from Grasshopper import DataTree

#Solver - Run with trees to enhance performance drastically
#--------------------------------------------------------------------------------------------
if __name__ == "__main__":
    
    #Initialize trees
    #--------------------------------------------------------------------------------------------
    TreeToWrap = DataTree[Object]()
    
    #Data matching
    #--------------------------------------------------------------------------------------------
    for path in L.Paths:
        listBranch = L.Branch(path)
        TreeToWrap.Add(listBranch,path)
    
     #Assign trees to output
    #--------------------------------------------------------------------------------------------
    O = TreeToWrap
# ---------- end l2o ----------
trim_17 = TrimTree(Tree=l2o, Depth=1)
repeat_2 = RepeatData(Data=trim_17, Length=expression_10)
trim_18 = TrimTree(Tree=repeat_2, Depth=1)
o2l = Object2List(O=trim_18)  # -> L; inputs O: tree
# ---------- o2l: Python ----------
#Component Information
#--------------------------------------------------------------------------------------------
if ghenv.Component.RunCount<2:
    #General
    #--------------------------------------------------------------------------------------------
    __author__ = "Ueli Saluz"
    __version__ = "2022.04.24"
    
    ghenv.Component.Name = "Object2List"
    ghenv.Component.NickName = "O2L"
    ghenv.Component.Description = "Unwraps a list of objects into a list object."
    ghenv.Component.Message = "VER 1.0"
    ghenv.Component.Category = "Sets"
    ghenv.Component.SubCategory = "Tree"
    
     #Inputs
    #--------------------------------------------------------------------------------------------
    inputIndex=0
    
    ghenv.Component.Params.Input[inputIndex].Name = "ListObject"
    ghenv.Component.Params.Input[inputIndex].NickName = "O"
    ghenv.Component.Params.Input[inputIndex].Description = "A python list object that will be unwrapped into a Grasshopper list."
    ghenv.Component.Params.Input[inputIndex].Optional = False
    inputIndex+=1
    

    #Outputs
    #--------------------------------------------------------------------------------------------
    outputIndex=0
    
    ghenv.Component.Params.Output[outputIndex].Name =  "List"
    ghenv.Component.Params.Output[outputIndex].NickName = "L"
    ghenv.Component.Params.Output[outputIndex].Description = "The unwrapped list."
    outputIndex+=1


#Imports
#--------------------------------------------------------------------------------------------
from System import Object
from Grasshopper import DataTree

#Solver - Run with trees to enhance performance drastically
#--------------------------------------------------------------------------------------------
if __name__ == "__main__":
    
    #Initialize trees
    #--------------------------------------------------------------------------------------------
    OriginalTree = DataTree[Object]()
    
    #Data matching
    #--------------------------------------------------------------------------------------------
    for path in O.Paths:
        listBranch = O.Branch(path)
        for i,listItem in enumerate(listBranch):
            OriginalTree.AddRange(list(listItem),path.AppendElement(i))
    
     #Assign trees to output
    #--------------------------------------------------------------------------------------------
    L = OriginalTree
# ---------- end o2l ----------
match = MatchTree(Tree=Z, Guide=o2l)
move = Move(Geometry=o2l, Motion=match)  # -> Geometry, Transform
crv_cp_2 = CurveClosestPoint(Point=move.Geometry, Curve=trim_11)  # -> Point, Parameter, Distance
eval_3 = EvaluateCurve(Curve=trim_11, Parameter=crv_cp_2.Parameter)  # -> Point, Tangent, Angle
rev = Reverse(Vector=eval_3.Tangent)
line = LineSDL(Start=eval_3.Point, Direction=Vector(0, 0, 1), Length=1)
vrot = Rotate(Vector=rev, Axis=line, Angle=degrees("90"))
pl = ConstructPlane(Origin=eval_3.Point, XAxis=rev, YAxis=vrot)
move_2 = Move(Geometry=pl, Motion=Z)  # -> Geometry, Transform
rotate = Rotate(Geometry=move_2.Geometry, Angle=degrees(expression_11), Plane=PlaneXY(0, 0, 0))  # -> Geometry, Transform
neg_2 = Negative(Value=expression_18)
relblbrch = RelabelBranches(TreeToMatch=rotate.Geometry, ListOfPaths=trim_16)  # -> RelabeledTree; inputs TreeToMatch: tree, ListOfPaths: list
# ---------- relblbrch: Python ----------
if ghenv.Component.RunCount<2:
    __author__ = "Your name"
    __version__ = "2000.00.00"
    
    ghenv.Component.Name = "RelabelBranches"
    ghenv.Component.NickName = "ReLblBrch"
    ghenv.Component.Description = "Relabel all the paths of the branches with a list of new paths. The amount of branches must match with the size of the list of pahts"
    ghenv.Component.Message = "VER 1.0"
    
    ghenv.Component.Params.Input[0].NickName = "TreeToMatch"
    ghenv.Component.Params.Input[1].NickName = "ListOfPaths"
    
    ghenv.Component.Params.Input[0].Description = "Tree that should be relabeled."
    ghenv.Component.Params.Input[1].Description = "List of paths to use for new branch paths."
    
    ghenv.Component.Params.Output[0].NickName = "RelabeledTree"
    ghenv.Component.Params.Output[0].Description = "Relabeled tree where all the paths of the branches have been replaced with new paths."

from System import Object
from Grasshopper import DataTree

def relabelBranchesWithLstOfPths (tree, paths):
    newTree = DataTree[Object]()
    for i,path in enumerate(tree.Paths):
        items = tree.Branch(path)
        for data in items:
            newTree.Add(data,paths[i])
    return newTree

if __name__ == "__main__":
    RelabeledTree = relabelBranchesWithLstOfPths(TreeToMatch,ListOfPaths)
# ---------- end relblbrch ----------
addition_3 = Addition(A=neg_2, B=slab_thickness_m)
Z_2 = UnitZ(Factor=addition_3)
move_3 = Move(Geometry=relblbrch, Motion=Z_2)  # -> Geometry, Transform
entranceplanes = Plane(move_3.Geometry)

lng_2 = ListLength(List=flatten(entranceplanes))
repeat_3 = RepeatData(Data=merge_3, Length=lng_2)
trim_19 = TrimTree(Tree=repeat_3, Depth=1)
loc_3 = ModelLocator(Validate=validate, Group="door", Subgroup=trim_19)  # -> Locator, Valid, Group, Subgroup
concat_16 = Concatenate(FragmentA="d", FragmentC=trim_19)

addition_4 = Addition(A=floor_height_m, B=expression_18)
addition_5 = Addition(A=addition_4, B=expression_18)
dom_2 = ConstructDomain(DomainStart=expression_18, DomainEnd=expression_16)
dom_3 = ConstructDomain(DomainStart=addition_4, DomainEnd=addition_5)
dom_4 = ConstructDomain(DomainStart=floor_height_m, DomainEnd=coreheight)
box_2 = DomainBox(Base=PlaneXY(0, 0, 0), X=_2d_2, Y=expression_17, Z=expression_18)
box_3 = DomainBox(Base=PlaneXY(0, 0, 0), X=neg, Y=expression_17, Z=dom_2)
box_4 = DomainBox(Base=PlaneXY(0, 0, 0), X=expression_17, Y=expression_17, Z=dom_3)
box_5 = DomainBox(Base=PlaneXY(0, 0, 0), X=_2d_2, Y=neg, Z=dom_4)
rotate_2 = Rotate(Geometry=box_2, Angle=degrees(expression_11), Plane=PlaneXY(0, 0, 0))  # -> Geometry, Transform
rotate_3 = Rotate(Geometry=box_3, Angle=degrees(expression_11), Plane=PlaneXY(0, 0, 0))  # -> Geometry, Transform
rotate_4 = Rotate(Geometry=box_4, Angle=degrees(expression_11), Plane=PlaneXY(0, 0, 0))  # -> Geometry, Transform
rotate_5 = Rotate(Geometry=box_5, Angle=degrees(expression_11), Plane=PlaneXY(0, 0, 0))  # -> Geometry, Transform
merge_6 = Merge(Data1=rotate_2.Geometry, Data2=rotate_3.Geometry)
merge_7 = Merge(Data1=rotate_4.Geometry, Data2=rotate_5.Geometry)
sunion = SolidUnion(Breps=merge_6)
sunion_2 = SolidUnion(Breps=merge_7)
filter = StreamFilter(Gate=include_top, Stream0=sunion_2)
filter_2 = StreamFilter(Gate=include_bottom, Stream0=sunion)
merge_8 = Merge(Data1=filter_2, Data2=filter)
sdiff = SolidDifference(BrepsA=corevolume, BrepsB=merge_8)
filter_3 = StreamFilter(Gate=nand, Stream0=corevolume, Stream1=sdiff)

subtraction_3 = Subtraction(A=coreheight, B=expression_18)
filter_4 = StreamFilter(Gate=include_top, Stream0=subtraction_3, Stream1=coreheight)
filter_5 = StreamFilter(Gate=include_bottom, Stream0=expression_18, Stream1="0")
Z_3 = UnitZ(Factor=1)
rev_2 = Reverse(Vector=Z_3)
pt = ConstructPoint(XCoordinate=0, YCoordinate=0, ZCoordinate=filter_4)
pt_2 = ConstructPoint(XCoordinate=0, YCoordinate=0, ZCoordinate=filter_5)
por = ModelPort(
    Validate=validate,
    Id="b",
    Description="The top system center of the elevator.",
    Point=pt_2,
    Direction=rev_2,
    Locators="bottom")  # -> Port, Valid, Id, Description, Point, Direction, Locators
por_2 = ModelPort(
    Validate=validate,
    Id="t",
    Description="The bottom system center of the elevator.",
    Point=pt,
    Direction=Z_3,
    Locators="top")  # -> Port, Valid, Id, Description, Point, Direction, Locators

deplane = DeconstructPlane(Plane=entranceplanes)  # -> Origin, XAxis, YAxis, ZAxis
pl_2 = ConstructPlane(Origin=deplane.Origin, XAxis=deplane.XAxis, YAxis=deplane.ZAxis)
_2d_3 = _2D(x=door_width_m)
rectangle_2 = Rectangle(Plane=pl_2, XSize=_2d_3, YSize=door_height_m, Radius=0)  # -> Rectangle, Length
doors = Rectangle(rectangle_2.Rectangle)

door_tree = Data(doors)
lng_3 = ListLength(List=flatten(door_tree))
repeat_4 = RepeatData(Data=flatten(shift), Length=lng_3)
trim_20 = TrimTree(Tree=repeat_4, Depth=1)
tstat_2 = TreeStatistics(Tree=door_tree)  # -> Paths, Length, Count
partition_2 = PartitionList(List=trim_20, Size=tstat_2.Length)
match_2 = MatchTree(Tree=partition_2, Guide=door_tree)  # -> flatten(Tree)
loc_4 = ModelLocator(Validate=validate, Group="facade", Subgroup=match_2)  # -> Locator, Valid, Group, Subgroup

panel_17 = Panel("""first
second
third
fourth""")
item_10 = ListItem(List=panel_17, Index=trim_19, Wrap=True)
concat_17 = Concatenate(
    FragmentG="The ",
    FragmentF=item_10,
    FragmentA=" door of the ",
    FragmentB=item_5,
    FragmentC=" plattform in the ",
    FragmentD=match_2,
    FragmentE=" facade.")

entranceplanes_2 = Plane(flatten(entranceplanes))
merge_9 = Merge(Data1=graft(loc.Locator), Data2=graft(loc_3.Locator), Data3=graft(loc_4.Locator), Data4=graft(loc_2.Locator))
concat_18 = Concatenate(FragmentC=concat, FragmentD="_", FragmentE=concat_16)  # -> graft(Result)
por_3 = ModelPort(Port=graft(entranceplanes_2), Validate=validate, Id=concat_18, Description=graft(concat_17), Locators=merge_9)  # -> Port, Valid, Id, Description, Point, Direction, Locators
trim_21 = TrimTree(Tree=por_3.Port, Depth=1)

doors_2 = Rectangle(flatten(doors))
geo = Geometry(filter_3)
expression_19 = Expression(x="doors", y=doors_2, Expression="x")
expression_20 = Expression(x="volume", y=geo, Expression="x")
merge_10 = Merge(Data1=expression_20, Data2=expression_19)
merge_11 = Merge(Data1=geo, Data2=doors_2)
concat_19 = Concatenate(FragmentA=par, FragmentB=sep, FragmentC=concat_11)
concat_20 = Concatenate(FragmentA=par, FragmentB=sep, FragmentC=concat_12)
blc = ExportBlock(path=concat_19, name=concat_5, url=concat_11, geo=merge_11, layer_name=merge_10, export=and)  # -> block_definition_3, path_4, exported_2
blc_2 = ExportBlock(path=concat_20, name=concat_6, url=concat_12, geo=merge_11, layer_name=merge_10, export=and)  # -> block_definition_3, path_4, exported_2

bbox = BoundingBox(Content=flatten(merge_11), Plane=PlaneXY(0, 0, 0), UnionBox=True)  # -> Box, Box_2
geo_2 = GeometryPreview(geo=merge_11)
zoom2bb = ZoomToBoundingBox(N=["Top", "Front", "Right", "Perspective", "Parallel"], BB=bbox.Box, S=0, R=zoom)  # -> F, SBB; inputs BB: Box, R: Boolean
# ---------- zoom2bb: Python ----------
#Component Information
#--------------------------------------------------------------------------------------------
if ghenv.Component.RunCount<2:
    #General
    #--------------------------------------------------------------------------------------------
    __author__ = "Ueli Saluz"
    __version__ = "2022.05.21"
    
    ghenv.Component.Name = "ZoomToBoundingBox"
    ghenv.Component.NickName = "Zoom2BB"
    ghenv.Component.Description = "Zoom the view of a Rhino viewport to a bounding box."
    ghenv.Component.Message = "VER 1.1"
    ghenv.Component.Category = "Display"
    ghenv.Component.SubCategory = "Camera"
    
     #Inputs
    #--------------------------------------------------------------------------------------------
    inputIndex=0
    
    ghenv.Component.Params.Input[inputIndex].Name = "Name"
    ghenv.Component.Params.Input[inputIndex].NickName = "N"
    ghenv.Component.Params.Input[inputIndex].Description = "Name of the viewport"
    ghenv.Component.Params.Input[inputIndex].Optional = False
    inputIndex+=1
    
    ghenv.Component.Params.Input[inputIndex].Name = "BoundingBox"
    ghenv.Component.Params.Input[inputIndex].NickName = "BB"
    ghenv.Component.Params.Input[inputIndex].Description = ""
    ghenv.Component.Params.Input[inputIndex].Optional = False
    inputIndex+=1
    
    ghenv.Component.Params.Input[inputIndex].Name = "ScaleFactor"
    ghenv.Component.Params.Input[inputIndex].NickName = "S"
    ghenv.Component.Params.Input[inputIndex].Description = "A factor for the extension of the bounding box." \
    +"0 means 0 extension, a positive number makes the bounding box larger a negative smaller. The amount is proportional to the length."
    ghenv.Component.Params.Input[inputIndex].Optional = False
    inputIndex+=1
   
    
    ghenv.Component.Params.Input[inputIndex].Name = "Run"
    ghenv.Component.Params.Input[inputIndex].NickName = "R"
    ghenv.Component.Params.Input[inputIndex].Description = "Zoom to the given bounding box."
    ghenv.Component.Params.Input[inputIndex].Optional = False
    inputIndex+=1
    
    #Outputs
    #--------------------------------------------------------------------------------------------
    outputIndex=0
    
    ghenv.Component.Params.Output[outputIndex].Name = "Finished"
    ghenv.Component.Params.Output[outputIndex].NickName = "F"
    ghenv.Component.Params.Output[outputIndex].Description = "Sends True when finished. Just to trigger other depending components."
    outputIndex+=1
    
    ghenv.Component.Params.Output[outputIndex].Name = "ScaledBoundingBox"
    ghenv.Component.Params.Output[outputIndex].NickName = "SBB"
    ghenv.Component.Params.Output[outputIndex].Description = "The scaled bounding box."
    outputIndex+=1


#Imports
#--------------------------------------------------------------------------------------------
from Rhino import RhinoDoc
from Rhino.Geometry import Box

#Solver - Run with trees to enhance performance drastically
#--------------------------------------------------------------------------------------------
if __name__ == "__main__":
    try:
        vp = RhinoDoc.ActiveDoc.Views.Find(N, False).ActiveViewport
        if R:
            box = BB
            bb = BB.BoundingBox
            bb.Inflate(S*box.X.Length,S*box.Y.Length,S*box.Z.Length)
            vp.ZoomBoundingBox(bb)
            SBB = bb
        F = True
    except:
        pass
# ---------- end zoom2bb ----------

rec = Rectangle({Plane=Plane(origin=(853.3612491, 852.5312947, 866.3069427), x=(0.7071067812, -0.7071067812, 0), y=(-0.4082482905, -0.4082482905, 0.8164965809)), Size=Domain2(u=-52.32632723..52.32632723, v=-27.88533994..27.88533994)})
merge_12 = Merge(Data1=geo, Data2=doors_2)
m2d_parallel = Make2DParallelView(Projection=rec)
make2d = Make2D(Geometry=merge_12, View=m2d_parallel, TangentEdges="T", TangentSeams=False, AutoComputeMake2D=True)  # -> VisibleCurves, VisibleIndex, VisibleType, HiddenCurves, HiddenIndex, HiddenType
trim_22 = TrimTree(Tree=make2d.VisibleCurves, Depth=1)
trim_23 = TrimTree(Tree=make2d.HiddenCurves, Depth=1)

expression_21 = Expression(x="visible", y=trim_22, Expression="x")
expression_22 = Expression(x="hidden", y=trim_22, Expression="x")
concat_21 = Concatenate(FragmentA=concat_4, FragmentB="_", FragmentC="icon")
concat_22 = Concatenate(FragmentC="icons", FragmentD=sep, FragmentA=concat_4)
merge_13 = Merge(Data1=trim_22, Data2=trim_23)
concat_23 = Concatenate(FragmentA=concat_22, FragmentB=".3dm")
merge_14 = Merge(Data1=expression_21, Data2=expression_22)
concat_24 = Concatenate(FragmentA=par, FragmentB=sep, FragmentC=concat_23)
blc_3 = ExportBlock(path=concat_24, name=concat_21, url=concat_23, geo=merge_13, layer_name=merge_14, export=and_2)  # -> block_definition_3, path_4, exported_2

aut = ModelAuthor(Name="Ueli Saluz", Email="ueli@semio-tech.org")  # -> Author, Valid, Name, Email
merge_15 = Merge(Data1=por.Port, Data2=por_2.Port, Data3=trim_21)

prv = PortPreview(po=merge_15)
typ = ModelType(
    Validate=validate,
    Name="Tambour",
    Description=concat_13,
    Icon=concat_14,
    Image=concat_15,
    Variant=item_4,
    Unit="m",
    Representations=merge_2,
    Ports=merge_15,
    Qualities=qal.Quality,
    Authors=aut.Author)  # -> Type, Valid, Name, Description, Icon, Image, Variant, Unit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
typ_2 = SerializeType(Type=typ.Type)
txt = EncodeText(Text=typ_2)
type = Text(txt)

typ_3 = PutType(Type=typ.Type, Uri=par, Run=save)

context_bake = ContextBake(Geometry=type)

# ==== cluster _2D
x = ClusterInput()
expression = Expression(x=x, Expression="x/2")
neg = Negative(Value=expression)
dom = ConstructDomain(DomainStart=neg, DomainEnd=expression)
I = ClusterOutput(dom)

# ==== cluster ValueOr0
value = ClusterInput()
value_2 = Number(value)
null = NullItem(Item=value_2)  # -> NullFlags, InvalidFlags, Description
filter = StreamFilter(Gate=null.NullFlags, Stream0=value_2, Stream1="0")
valueor0 = Number(filter)
valueor0_2 = ClusterOutput(valueor0)

# ==== cluster PreviewPlane: Preview a plane with axis colors and naming.
axis_length = ClusterInput()
plane = ClusterInput()
axis_length_2 = Number(axis_length)
plane_2 = Plane(plane)
deplane = DeconstructPlane(Plane=plane_2)  # -> Origin, XAxis, YAxis, ZAxis
line = LineSDL(Start=deplane.Origin, Direction=deplane.YAxis, Length=axis_length_2)
line_2 = LineSDL(Start=deplane.Origin, Direction=deplane.XAxis, Length=axis_length_2)
line_3 = LineSDL(Start=deplane.Origin, Direction=deplane.ZAxis, Length=axis_length_2)
swatch = ColourSwatch(SwatchColor=RGB(235, 52, 79))
swatch_2 = ColourSwatch(SwatchColor=RGB(0, 166, 157))
swatch_3 = ColourSwatch(SwatchColor=RGB(240, 117, 24))
end = EndPoints(Curve=line_2)  # -> Start, End
end_2 = EndPoints(Curve=line)  # -> Start, End
end_3 = EndPoints(Curve=line_3)  # -> Start, End
tag = TextTag(Location=end.End, Text="X", Colour=swatch)
tag_2 = TextTag(Location=end_2.End, Text="Y", Colour=swatch_2)
tag_3 = TextTag(Location=end_3.End, Text="Z", Colour=swatch_3)
preview = CustomPreview(Geometry=line_2, Material=swatch)
preview_2 = CustomPreview(Geometry=line, Material=swatch_2)
preview_3 = CustomPreview(Geometry=line_3, Material=swatch_3)

# ==== cluster ViewRectangle
view = ClusterInput()
view_2 = Data(view)
nickname = NAME(view=view_2)  # -> c, x, y, z, h, w
# ---------- nickname: Python ----------
uselss, c, x, y, z = view.GetCameraFrame()
h = view.FrustumHeight
w = view.FrustumWidth
# ---------- end nickname ----------
rev = Reverse(Vector=nickname.x)
rev_2 = Reverse(Vector=nickname.y)
pl = ConstructPlane(Origin=nickname.c, XAxis=rev, YAxis=nickname.y)
_2d = _2D(x=nickname.w)
_2d_2 = _2D(x=nickname.h)
rectangle = Rectangle(Plane=pl, XSize=_2d, YSize=_2d_2, Radius=0)  # -> Rectangle, Length
rec = Rectangle(rectangle.Rectangle)
rec_2 = ClusterOutput(rec)

# ==== cluster ExportBlock: Export geometry with layer names to a file.
path = ClusterInput()
name = ClusterInput()
url = ClusterInput()
geo = ClusterInput()
layer_name = ClusterInput()
export = ClusterInput()
path_2 = FilePath(path)
name_2 = Text(name)
url_2 = Text(url)
geo_2 = Geometry(geo)
layer_name_2 = Text(layer_name)
export_2 = Boolean(export)
layer = ModelLayer(Name=layer_name_2)  # -> Layer, Name, Hidden, Locked, DisplayColour, Material, Linetype
object = ModelObject(Geometry=geo_2, Layer=layer.Layer)  # -> Object, Geometry, Name, Layer, Visibility, Display, Drafting, Render
block_definition = ModelBlockDefinition(Objects=object.Object, Name=name_2, URL=url_2)  # -> BlockDefinition, Objects, Units, Name, Notes, URL, URLDescription
export_definition = ExportModelBlockDefinition(BlockDefinition=block_definition.BlockDefinition, FilePath=path_2, Overwrite="T", Export=export_2)  # -> BlockDefinition, FilePath, Exported
block_definition_2 = ModelBlockDefinition(export_definition.BlockDefinition)
path_3 = FilePath(export_definition.FilePath)
exported = Boolean(export_definition.Exported)
path_4 = ClusterOutput(path_3)
exported_2 = ClusterOutput(exported)
block_definition_3 = ClusterOutput(block_definition_2)

# ==== cluster PortPreview: semio styled preview of ports.
po = ClusterInput()
po_2 = Port(po)
por = ModelPort(Port=po_2)  # -> Port, Valid, Id, Description, Point, Direction, Locators
vdisex = VectorDisplayEx(Point=por.Point, Vector=por.Direction, Colour=ColourSwatch(SwatchColor=RGB(0, 166, 157)), Width=2)
preview = CustomPreview(Geometry=por.Point, Material=ColourSwatch(SwatchColor=RGB(235, 52, 79)))
tag = TextTag(Location=por.Point, Text=por.Id, Colour=ColourSwatch(SwatchColor=RGB(250, 149, 0)))

# ==== cluster GeometryPreview: semio styled preview of geometry.
geo = ClusterInput()
geo_2 = Geometry(flatten(geo))
debrep = DeconstructBrep(Brep=geo_2)  # -> Faces, Edges, Vertices
preview = CustomPreview(Geometry=flatten(debrep.Edges), Material=ColourSwatch(SwatchColor=RGB(0, 0, 0)))
preview_2 = CustomPreview(Geometry=flatten(debrep.Faces), Material=ColourSwatch(SwatchColor=RGB(255, 255, 255)))
